# Grasshopper definition isocurvature_release.gh (Grasshopper 1.0.7)

srf = Surface(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)
srf_2 = Surface(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)
brep = Brep(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)
pt = Point(Point(0, 0, 0))
number_slider = Slider(0.25, range=0..0.25)
number_slider_2 = Slider(75, range=0..300)
brep_2 = Brep(brep)
srf_3 = Surface(srf)
srf_4 = Surface(srf_2)

cluster = Cluster_2(pt=pt, B=srf_3, N=number_slider)  # -> P, vec_2
cluster_2 = Cluster_2(pt=pt, B=srf_4, N=number_slider)  # -> P, vec_2
cluster_3 = Cluster_2(pt=pt, B=brep_2, N=number_slider)  # -> P, vec_2

python = GhPythonScript(initP=cluster.P, dir=cluster.vec_2, L=number_slider_2, bSrf=srf_3)  # -> graft(UV), pUV; inputs initP: Point3d, dir: list
# ---------- python: Python ----------
"""Taking in an origin point, two vectors that may be orthogonal and a surface, 
and create equadistant points on the surface along these two vectors

Inputs:
    initP: Starting point
    dir: vector in the UV directions
    L: desired length between the points
    bSrf: the surface the points are mapped to
    UVi: Optional, may be used to restrict number of points along the vectors
Output:
    UV: Number of points in the UV direction
    pUV: List of points in the UV direction """
        
import ghpythonlib.treehelpers as th
import rhinoscriptsyntax as rs
import Rhino
import math
        
def linearMap(initP, dir1, dir2, L):
            
    pList=[]
    pList.append(initP)
    prevP=initP
    
    first=True
    
    while True:
        
        cirPlane=rs.PlaneFromNormal(prevP,dir2)
        cirCrv=rs.AddCircle(cirPlane,L)
        intP=rs.CurveBrepIntersect(cirCrv,bSrf)[1]
        if first==True: # The first circle has two equidistant x-sec points
            first=False            
            testP=rs.CopyObject(initP,dir1*2) # Create a test point in the pos U/V dir
                
            if len(intP)>1: # if there are two intersections, that means there's a point on either side of the initP
                if rs.Distance(testP,intP[0])<rs.Distance(testP,intP[1]):
                    tempP=intP[0]
                else:
                    tempP=intP[1]
            elif len(intP)==1: # if there's one point then pick that point
                if rs.Distance(testP,intP[0])<rs.Distance(initP,intP[0]):
                    tempP=intP[0]
                else:
                    break
            else: # else there is no intersection
                break
        else:
            if len(intP)>1: # If there are two intersecting points, so it hasn't fallen off the cliff
                if rs.Distance(pList[-2],intP[0])>rs.Distance(pList[-2],intP[1]):
                    tempP=intP[0]
                else:
                    tempP=intP[1]
            else:
                break
        prevP=tempP
        pList.append(tempP)       
    return pList
            
pTreeU=[]
pTreeV=[]
        
numQuad=4

idx=[[1,1],[-1,1]]

for i in idx:
    pTreeU.append(linearMap(initP,i[0]*dir[0],i[1]*dir[1],L))

pTreeU.append(pTreeU[1])
pTreeU.append(pTreeU[0])

idx=[[1,1],[-1,-1]]

for i in idx:
    pTreeV.append(linearMap(initP,i[0]*dir[1],i[1]*dir[0],L))

pTreeV=[val for val in pTreeV for _ in (0, 1)]

pUV=th.list_to_tree([pTreeU,pTreeV])

UV=th.list_to_tree([[len(pTreeU[k]) for k in range(numQuad)],[len(pTreeV[k]) for k in range(numQuad)]])
# ---------- end python ----------
python_2 = GhPythonScript(initP=cluster_2.P, dir=cluster_2.vec_2, L=number_slider_2, bSrf=srf_4)  # -> graft(UV), pUV; inputs initP: Point3d, dir: list; same code as python
python_3 = GhPythonScript(initP=cluster_3.P, dir=cluster_3.vec_2, L=number_slider_2, bSrf=brep_2)  # -> graft(UV), pUV; inputs initP: Point3d, dir: list; same code as python

python_4 = GhPythonScript(UVi=[python.UV, python_2.UV, python_3.UV], pUVi1=python.pUV, pUVi2=python_2.pUV, pUVi3=python_3.pUV)  # -> UV, pUV1, pUV2, pUV3; inputs UVi: tree, pUVi1: tree, pUVi2: tree, pUVi3: tree
# ---------- python_4: Python ----------
"""Taking in an origin point, two vectors that may be orthogonal and a surface, 
and create equadistant points on the surface along these two vectors

Inputs:
    initP: Starting point
    dir: vector in the UV directions
    L: desired length between the points
    bSrf: the surface the points are mapped to
    UVi: Optional, may be used to restrict number of points along the vectors
Output:
    UV: Number of points in the UV direction
    pUV: List of points in the UV direction """

import ghpythonlib.treehelpers as th
import rhinoscriptsyntax as rs
import Rhino
import math
        
listQuad=range(4)

def truncList(list,l,i):
    if l.BranchCount==0:
        return list
    else:
        lList=l.Branches[i]
        return [value[0:il] for value,il in zip(list,lList)]

nU=[min(i) for i in [UVi.Branch(0,0,j) for j in listQuad]]
nV=[min(i) for i in [UVi.Branch(0,1,j) for j in listQuad]]

UV=th.list_to_tree([nU,nV])

pU1=[i[0:nU[k]] for k,i in enumerate([pUVi1.Branch(0,0,j) for j in listQuad])]
pV1=[i[0:nV[k]] for k,i in enumerate([pUVi1.Branch(0,1,j) for j in listQuad])]

pU2=[i[0:nU[k]] for k,i in enumerate([pUVi2.Branch(0,0,j) for j in listQuad])]
pV2=[i[0:nV[k]] for k,i in enumerate([pUVi2.Branch(0,1,j) for j in listQuad])]

pU3=[i[0:nU[k]] for k,i in enumerate([pUVi3.Branch(0,0,j) for j in listQuad])]
pV3=[i[0:nV[k]] for k,i in enumerate([pUVi3.Branch(0,1,j) for j in listQuad])]

pUV1=th.list_to_tree([pU1,pV1])
pUV2=th.list_to_tree([pU2,pV2])
pUV3=th.list_to_tree([pU3,pV3])
# ---------- end python_4 ----------
python_5 = GhPythonScript(UVi=python_4.UV)  # -> pId, GridId; inputs UVi: tree
# ---------- python_5: Python ----------
"""Create an diagonally incrementing matrix, and the two previous IDs each ID is associated with

    Inputs:
        UVi: Number of points in UV directions in the four quadrants
    Output:
        pId: Tuples of (n0, n1, n2) n1 and n2 are origins of the sphere, 
        n0 is one intersection between the circle and the surface
        gridId: The diagonally incrementing matrix"""
                
import ghpythonlib.treehelpers as th
import rhinoscriptsyntax as rs

numQuad=4

diaGridIdTree=[]
pIdTree=[]
        
nU=UVi.Branches[0]   
nV=UVi.Branches[1]        
# Trim a tree row wise then column wise
def trimTree(listIn):
    listOut=[]
    for i in range(len(listIn)):
        for j in range(len(listIn[0])):
                listOut.append(listIn[i][j])
    return listOut
    
# Sort a list based on foreign keys using dictionary
def sortList(key,value):
    sortedList=[]
    for i in range(len(key)):
        testDic=dict(zip(key[i],value[i]))
        sortedList.append(testDic.values())
    return sortedList

for i in range(numQuad): # Four quadrant
    diaGridId=[]
    pId=[]
    pCoord=[]

    for j in range(nU[i]):
            diaGridId.append(range(nV[i]))
                    
    # Create a diagonally incrementing matrix       
    m=0
    for p in range(nU[i]+nV[i]-1):
        for q in range(max(p-nU[i]+1,0),min(p+1,nV[i])):
            diaGridId[p-q][q]=m
            m=m+1

    for j in range(nU[i]):
        for k in range(nV[i]):
            pId.append([diaGridId[j-1][k-1],diaGridId[j][k-1],diaGridId[j-1][k]])

    diaGridIdTree.append(trimTree(diaGridId))
    pIdTree.append(pId)

pId         =   th.list_to_tree(sortList(diaGridIdTree,pIdTree))
GridId      =   th.list_to_tree(diaGridIdTree)
# ---------- end python_5 ----------
python_6 = GhPythonScript(UVi=python_4.UV, pUVi=python_4.pUV1, pId=python_5.pId, GridId=python_5.GridId, bSrf=srf_3, L=number_slider_2)  # -> triSrf, nmSrf, deltaDist, deltaDist2, pCoord, orthoLines, crxLines, crxAngles, crxBiline, intCrxP; inputs UVi: tree, pUVi: tree, pId: tree, GridId: tree of Int32
# ---------- python_6: Python ----------
import ghpythonlib.treehelpers as th
import rhinoscriptsyntax as rs
import math

def trimTree(listIn):
    listOut=[]
    for i in range(len(listIn)):
        for j in range(len(listIn[0])):
                listOut.append(listIn[i][j])
    return listOut
    
def sortList(key,value):
    testDic=dict(zip(key,value))
    return testDic.values()
    

def truncMat(mat,i,l):
    temp=zip(*[iter(list(mat))]*l)
    temp2=[sortedId[i:] for sortedId in temp[i:]]
    return [item for sublist in temp2 for item in sublist]
    
def avgPtFun(p):
    X=0
    Y=0
    Z=0
    numPt=len(p)
    for pi in p:
        i=rs.coerce3dpoint(pi)
        X=X+i.X
        Y=Y+i.Y
        Z=Z+i.Z
    return rs.AddPoint([X/numPt,Y/numPt,Z/numPt])

nU=UVi.Branches[0]
nV=UVi.Branches[1]

pU=[pUVi.Branch(0,0,x) for x in range(4)]
pV=[pUVi.Branch(0,1,x) for x in range(4)]

orthoLines=[]
crxLines=[]
deltaDist=[]
crxLines2=[]
deltaDist2=[]
existTree=[]
crxAngles=[]
crxBiline=[]
intCrxP=[]
nmSrf=[]
actSrf=[]
triSrf=[]
nmVLinesL=[]

numQuad=4

pListID=[1,0,2,3]

pCoord=[]
pId=th.tree_to_list(pId)
pTemp=rs.AddPoint([0,0,0])

Lx=L/2./(math.sin(math.pi/4.))

for i in range(numQuad): # For the four quadrant
    pCoordQuad=[[pTemp for j in range(nV[i])] for k in range(nU[i])]
    
    for j in range(nU[i]):
        pCoordQuad[j][0]=pU[i][j]
                
    for j in range(nV[i]):
        pCoordQuad[0][j]=pV[i][j]

    pCoord.append(sortList(GridId.Branch(i),trimTree(pCoordQuad)))

counter=0
for i in range(numQuad): # For the four quadrant
    pCoordList=pCoord[i]
    pIdList=pId[i]
    
    subGridIdList=truncMat(GridId.Branch(i), 1, nV[i])
    
    p=[0,0,0,0]
    
    for sGId, subGridId in enumerate(subGridIdList):
        
        exist=0
        [pID0,pID1,pID2]=pIdList[subGridId]
        
        p[0]=pCoordList[int(pID0)]
        p[1]=pCoordList[int(pID1)]
        p[2]=pCoordList[int(pID2)]
        
        d=rs.Distance(p[1],p[2])
        r=L
        
        if d!=0:
            
            x = d/2 # Angle of intersecting spheres http://mathworld.wolfram.com/Sphere-SphereIntersection.html
            
            dLine=rs.AddLine(p[1],p[2]) # Add a diagonal line
            dVec=rs.VectorCreate(p[2],p[1]) # Create vector
            
            cP=rs.CurveMidPoint(dLine) # Find the mid point of the diagonal line
            a=rs.Distance(p[0],cP) # Distance between p[0] and intersection
            pP=rs.PlaneFromNormal(cP,dVec) # create plane to 
            cir=rs.AddCircle(pP,a) #Create the circle
                    
            intP=rs.CurveBrepIntersect(cir,bSrf)
                    
            if intP!=None: #If there is intersection
                intP=intP[1]
                        
                if len(intP)>1: # If both points are on the surface
                    if rs.Distance(p[0],intP[0])>rs.Distance(p[0],intP[1]):
                        p[3]=intP[0]
                    else:
                        p[3]=intP[1]
                        
                    
                    testDis=[abs(rs.Distance(p[pListID[i-1]],p[pListID[i]])-L)>0.01 for i in range(4)]
                    
                    if any(testDis)!=True:
                        
                        avgPt       = avgPtFun(p) # average point
                        
                        normal      = [rs.BrepClosestPoint(bSrf, p[pListID[i]])[3] for i in range(4)]
                        normPt1     = [rs.CopyObject(p[pListID[i]],-50*normal[i]) for i in range(4)]
                        normPt2     = [rs.CopyObject(p[pListID[i]],+50*normal[i]) for i in range(4)]
                        
                        nmHLines1   = [rs.AddLine(normPt1[i-1],normPt1[i]) for i in range(4)]
                        nmHLines2   = [rs.AddLine(normPt2[i-1],normPt2[i]) for i in range(4)]
                        
                        nmHSrf1     = rs.AddEdgeSrf(nmHLines1)
                        nmHSrf2     = rs.AddEdgeSrf(nmHLines2)
                        
                        nmVLines    = [rs.AddLine(normPt1[i],normPt2[i]) for i in range(4)]
                        
                        nmSrfI      = [rs.AddLoftSrf([nmVLines[ii],nmVLines[jj]]) for ii,jj in zip([1,0,2,3],[2,1,3,0])]
                        
                        nmSrfI.append(nmHSrf1)
                        nmSrfI.append(nmHSrf2)
                        
                        nmSrf.append(rs.JoinSurfaces(nmSrfI))
                        
                        
                        normPt3     = [rs.CopyObject(p[pListID[i]],+5*normal[i]) for i in range(4)]
                        
                        nmVLinesS    = [rs.AddLine(p[pListID[i]],normPt3[i]) for i in range(4)]
                        nmVLinesL.append(nmVLinesS)
                        
                        lines       = [rs.AddLine(p[pListID[i-1]],p[pListID[i]]) for i in range(4)]
                        
                        srf         = rs.AddEdgeSrf(lines)
                        actSrf.append(srf)
                        
                        parameter   = rs.SurfaceParameter(srf, (0.5, 0.5))
                        normVec     = rs.VectorUnitize(rs.SurfaceNormal(srf,parameter))
                        
                        normLine    = rs.AddLine(rs.CopyObject(avgPt,-100*normVec),rs.CopyObject(avgPt,100*normVec))
                        
                        intCrxP.append(rs.CurveBrepIntersect(normLine,bSrf)[1][0])
                        
                        triSrfI      = [rs.AddSrfPt([intCrxP[-1],p[pListID[i-1]],p[pListID[i]]]) for i in range(4)]
                        triSrf.append(rs.JoinSurfaces(triSrfI))
                        pCoordList[subGridId]=p[3]
                        
                        # Create cross edges
                        crxLines.append([rs.AddLine(p[i],intCrxP[-1]) for i in pListID])
                        deltaDist.append([rs.CurveLength(crxLines[-1][i])-Lx for i in range(4)])
                        crxLines2.append([rs.AddLine(p[i],avgPt) for i in pListID])
                        deltaDist2.append([rs.CurveLength(crxLines2[-1][i])-Lx for i in range(4)])
                        crxAngles.append([rs.Angle2(crxLines[-1][i],crxLines[-1][i+2]) for i in [0,1]])
                        
                        # Create quad polyline
                        orthoLines.append(rs.JoinCurves(lines))
                        
                        # Create bilines
                        crxBiline.append([rs.JoinCurves([rs.AddLine(p[pListID[i-2]],p[pListID[i-1]]),rs.AddLine(p[pListID[i-1]],p[pListID[i]])]) for i in range(4)])
                        exist=1
                        
                        
        if exist==0:
            triSrf.append(None)
            actSrf.append(None)
            nmSrf.append(None)
            intCrxP.append([None])
            orthoLines.append([None])
            deltaDist.append([None,None,None,None])
            deltaDist2.append([None,None,None,None])
            crxLines.append([None,None,None,None])
            crxLines2.append([None,None,None,None])
            crxAngles.append([None,None])
            crxBiline.append([[None],[None],[None],[None]])

nmVLinesL=th.list_to_tree(nmVLinesL)
triSrf=th.list_to_tree(triSrf)
actSrf=th.list_to_tree(actSrf)
nmSrf=th.list_to_tree(nmSrf)
deltaDist=th.list_to_tree(deltaDist)
deltaDist2=th.list_to_tree(deltaDist2)
pCoord=th.list_to_tree(pCoord)
crxLines=th.list_to_tree(crxLines)
crxLines2=th.list_to_tree(crxLines2)
orthoLines=th.list_to_tree(orthoLines)
crxAngles=th.list_to_tree(crxAngles)
crxBiline=th.list_to_tree(crxBiline)

intCrxP=th.list_to_tree(intCrxP)
# ---------- end python_6 ----------
python_7 = GhPythonScript(UVi=python_4.UV, pUVi=python_4.pUV2, pId=python_5.pId, GridId=python_5.GridId, bSrf=srf_4, L=number_slider_2)  # -> nmVLinesL, triSrf, nmSrf, deltaDist, deltaDist2, pCoord, orthoLines, crxLines, crxAngles, crxBiline; inputs UVi: tree, pUVi: tree, pId: tree, GridId: tree of Int32; same code as python_6
python_8 = GhPythonScript(UVi=python_4.UV, pUVi=python_4.pUV3, pId=python_5.pId, GridId=python_5.GridId, bSrf=brep_2, L=number_slider_2)  # -> nmVLinesL, triSrf, nmSrf, deltaDist, deltaDist2, pCoord, orthoLines, crxLines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; inputs UVi: tree, pUVi: tree, pId: tree, GridId: tree of Int32; same code as python_6
cluster_4 = Cluster(I=python_6.pCoord, I_2=python_7.pCoord, I_3=python_8.pCoord)  # -> T, T_2, T_3
cluster_5 = Cluster(I=python_6.orthoLines, I_2=python_7.orthoLines, I_3=python_8.orthoLines)  # -> T, T_2, T_3
cluster_6 = Cluster(I=python_6.crxLines, I_2=python_7.crxLines, I_3=python_8.crxLines)  # -> T, T_2, T_3

# ==== cluster Cluster
I = ClusterInput()
I_2 = ClusterInput()
I_3 = ClusterInput()
null = NullItem(Item=I)  # -> NullFlags, InvalidFlags, Description
null_2 = NullItem(Item=I_2)  # -> NullFlags, InvalidFlags, Description
null_3 = NullItem(Item=I_3)  # -> NullFlags, InvalidFlags, Description
or = GateOr(A=null.NullFlags, B=null_2.NullFlags, C=null_3.NullFlags)
not = GateNot(A=or)
cull = CullPattern(List=I, CullPattern=not)
cull_2 = CullPattern(List=I_2, CullPattern=not)
cull_3 = CullPattern(List=I_3, CullPattern=not)
clean = CleanTree(RemoveNulls=True, RemoveInvalid=True, RemoveEmpty=True, Tree=cull)
clean_2 = CleanTree(RemoveNulls=True, RemoveInvalid=True, RemoveEmpty=True, Tree=cull_2)
clean_3 = CleanTree(RemoveNulls=True, RemoveInvalid=True, RemoveEmpty=True, Tree=cull_3)
T = ClusterOutput(clean)
T_2 = ClusterOutput(clean_2)
T_3 = ClusterOutput(clean_3)

# ==== cluster Cluster_2
number_slider = Slider(1000, range=0..1000)
pt = ClusterInput()
expression = Expression(x=number_slider, Expression="-x/2")
pt_2 = Point(pt)
Z = UnitZ(Factor=expression)
move = Move(Geometry=pt_2, Motion=Z)  # -> Geometry, Transform
N = ClusterInput()
line = LineSDL(Start=move.Geometry, Direction=Vector(0, 0, 1), Length=number_slider)
pi = Pi(Factor=N)
pi_2 = Pi(Factor=Slider(0.5, range=0..1))
X = UnitX(Factor=1)
B = ClusterInput()
rotate = Rotate(Geometry=X, Angle=pi, Plane=PlaneXY(0, 0, 0))  # -> Geometry, Transform
blx = BrepLine(Brep=B, Line=line, LimitToFirst=False)  # -> Curves, Points
rotate_2 = Rotate(Geometry=rotate.Geometry, Angle=pi_2, Plane=PlaneXY(0, 0, 0))  # -> Geometry, Transform
P = ClusterOutput(blx.Points)
vec = Vector([rotate.Geometry, rotate_2.Geometry])
vec_2 = ClusterOutput(vec)
